# Dynamo graph single_panel_articulation.dyn

python_script = Python()
# ---------- python_script.python (51 lines) ----------
import sys
path = 'C:\\Users\\t_nguyp\\Desktop\\Dynamo\\Release'
sys.path.append(path)
import clr
clr.AddReference('LibGNet')
from Autodesk.LibG import *

from Autodesk.LibG import Point,Line,Surface,Polygon,Geometry,Vector,Solid

#The input to this node will be stored in the IN variable.
dataEnteringNode = IN

solid = IN

solid_surfaces = solid.get_faces ()

surf_centroids = solid_surfaces[2].get_centroid()

srf_area_list = []
for surface in solid_surfaces:
	srf_area_list.append( [surface, surface.get_area()] )

sorted_surfaces = sorted(srf_area_list, key = lambda x: x[1], reverse = True)

clean_list = []
for i in range(2):
	clean_list.append([ sorted_surfaces[i][0] , sorted_surfaces[i][0].get_centroid().z() ])
	
final_sort_list = sorted(clean_list, key = lambda x: x[1], reverse = True)

vertices = final_sort_list[0][0].get_vertices ()
top_surface = final_sort_list[0][0].get_surface_geometry()
bottom_surface = final_sort_list[1][0].get_surface_geometry()


#offset_surfaces
#top_surface = top_surface.offset(3.0)
#bottom_surface = bottom_surface.offset(3.0)

"""
test_Cent = final_sort_list[0][0].get_centroid()
sphere = Sphere.by_center_radius (test_Cent, 20.0)

face_points = []
for v in vertices:
	face_points.append(v.get_point_geometry() )
	
test = solid.subtract_from(sphere, True, True, True)
"""
#Assign your output to the OUT variable
OUT = top_surface, bottom_surface
# ----------------------------------------
file_path = StringFilename("C:\dev\Generative-drop-ceiling\Python\panel_boolean_subtraction.py")
read_text_file = FileReader(file_path)
file_path_2 = StringFilename("C:\dev\Generative-drop-ceiling\maple_mockup\reg_planar_solids.sat")
import_sat = ImportSATNode(file_path_2, lacing=Longest)
watch = Watch(import_sat)
python_script_from_string = PythonString(read_text_file, watch)
watch_2 = Watch(python_script_from_string)
draw = ForceDrawNode(watch_2, lacing=Longest)
watch_3d = Watch3D(draw)
python_script_2 = Python()
# ---------- python_script_2.python (11 lines) ----------
import System
from System import *

rand = Random()
OUT = (rand.Next() % 1000000) / 1000000.0

#The input to this node will be stored in the IN variable.
dataEnteringNode = IN

#Assign your output to the OUT variable
OUT = 0
# ----------------------------------------
string = StringInput("C:\dev\Generative-drop-ceiling\maple_mockup\Ceiling_pattern_tester.sat")
export_to_sat = ExportSATNode(string, draw, lacing=Longest)
string_2 = StringInput("C:\dev\Generative-drop-ceiling\maple_mockup\reg_planar_solids.sat")
string_3 = StringInput("C:\dev\Generative-drop-ceiling\Python\panel_boolean_subtraction")
